# Grasshopper definition shrink_obj.gh (Grasshopper 1.0.7)

geo = Geometry(<mesh referenced from the Rhino model>)
facec = FaceCircles(Mesh=geo)  # -> Centers, Ratio
faceb = FaceBoundaries(Mesh=geo)
pt = Point(facec.Centers)
incurve = PointInCurve(Point=pt, Curve=faceb)  # -> Relationship, Point
pt_2 = Point(incurve.Point)
equals = Equality(FirstNumber=incurve.Relationship, SecondNumber=Slider(2, range=0..2))  # -> Equality, Inequality
dispatch = Dispatch(List=pt_2, DispatchPattern=equals.Inequality)  # -> ListA, ListB
pt_3 = Point(dispatch.ListB)
