# Grasshopper definition surface_area.gh (Grasshopper 1.0.7)

sph = Sphere(Base=PlaneXY(0, 0, 0), Radius=1)
vec = VectorXYZ(XComponent="25", YComponent="25", ZComponent="25")  # -> Vector, Length
move = Move(Geometry=sph, Motion=vec.Vector)  # -> Geometry, Transform
z_range_min = Number("0")
z_range_max = Number("50")
domain_max = Number("50")
domain_min = Number("0")
split_num = Number("36")
scale = Scale(Geometry=move.Geometry, Center=vec.Vector, Factor="20")  # -> Geometry, Transform
vec_2 = VectorXYZ(XComponent="5", YComponent="5", ZComponent="5")  # -> Vector, Length
dom = ConstructDomain(DomainStart=domain_min, DomainEnd=domain_max)
rectangle = Rectangle(Plane=PlaneXY(0, 0, 0), XSize="40", YSize="40", Radius=0)  # -> Rectangle, Length
move_2 = Move(Geometry=rectangle.Rectangle, Motion=vec_2.Vector)  # -> Geometry, Transform
range = Range(Domain=dom, Steps=split_num)  # -> graft(Range)
range_2 = Range(Domain=dom, Steps=split_num)
number_slider = Slider(24, range=0..24)
srf = Surface(move_2.Geometry)
vec_3 = VectorXYZ(XComponent=range, YComponent=range_2, ZComponent=0)  # -> flatten(Vector), Length
subtraction = Subtraction(A=domain_min, B=domain_max)
pcen = PolygonCenter(Polyline=srf)  # -> CenterV, CenterE, CenterA
sdivide = DivideSurface(Surface=srf, UCount=number_slider, VCount=number_slider)  # -> flatten(Points), Normals, Parameters
abs = Absolute(Value=subtraction)
division = Division(A=abs, B=split_num)
ln = Line(StartPoint=pcen.CenterV, EndPoint=sdivide.Points)
domain_width = Number(division)
len = Length(Curve=ln)  # -> simplify(Length)
vec_4 = Vector(graft(vec_3.Vector))
panel = Panel(vec_4)
panel_2 = Panel(len)
bnd = Bounds(Numbers=len)
xy = XYPlane(Origin=Point(0, 0, 0))
multiplication = Multiplication(A=Slider(3, range=0..24), B="360")
remap = RemapNumbers(Value=len, Source=bnd, Target=multiplication)  # -> Mapped, Clipped
rectangle_2 = Rectangle(Plane=xy, XSize=domain_width, YSize=domain_width, Radius=0)  # -> Rectangle, Length
rad = Radians(Degrees=remap.Mapped)
boundary = BoundarySurfaces(Edges=rectangle_2.Rectangle)
sin = Sine(Value=rad)
move_3 = Move(Geometry=boundary, Motion=vec_4)  # -> Geometry, Transform
z_range_min_2 = Number(z_range_min)
z_range_max_2 = Number(z_range_max)
multiplication_2 = Multiplication(A=sin, B=Slider(2, range=0..500))
Z = UnitZ(Factor=multiplication_2)
subtraction_2 = Subtraction(A=z_range_min_2, B=z_range_max_2)
move_4 = Move(Geometry=sdivide.Points, Motion=Z)  # -> flatten(Geometry), Transform
abs_2 = Absolute(Value=subtraction_2)
addition = Addition(A=number_slider, B="1")
z_range_width = Number(abs_2)
srfgrid = SurfaceFromPoints(Points=move_4.Geometry, UCount=addition, Interpolate=False)
srf_2 = Surface(srf)
mesh = Mesh(srf_2)
Z_2 = UnitZ(Factor=abs_2)
extr = Extrude(Base=move_3.Geometry, Direction=Z_2)
bvol = BoundaryVolume(Boundaries=extr)
sint = SolidIntersection(BrepsA=srf_2, BrepsB=bvol)
null = NullItem(Item=sint)  # -> NullFlags, InvalidFlags, Description
and = GateAnd(A=null.NullFlags, B=null.InvalidFlags)
dispatch = Dispatch(List=sint, DispatchPattern=and)  # -> ListA, ListB
brep = Brep(flatten(dispatch.ListB))
debrep = DeconstructBrep(Brep=brep)  # -> Faces, Edges, Vertices
lng = ListLength(List=debrep.Faces)
panel_3 = Panel(lng)
equals = Equality(FirstNumber=lng, SecondNumber="6")  # -> Equality, Inequality
dispatch_2 = Dispatch(List=debrep.Faces, DispatchPattern=equals.Equality)  # -> ListA, ListB
srf_3 = Surface(flatten(dispatch_2.ListA))
mesh_2 = Mesh(srf_3)
demesh = DeconstructMesh(Mesh=mesh_2)  # -> Vertices, Faces, Colours, Normals
facen = FaceNormals(Mesh=srf_3)  # -> Centers, Normals
panel_4 = Panel("{0}")
Z_3 = UnitZ(Factor=1)
dprod = DotProduct(VectorA=demesh.Normals, VectorB=Z_3, Unitize=False)
avr = Average(Input=dprod)  # -> flatten(ArithmeticMean)
abs_3 = Absolute(Value=avr)
smaller = SmallerThan(FirstNumber=abs_3, SecondNumber="0.001")  # -> SmallerThan, OrEqualTo
dispatch_3 = Dispatch(List=srf_3, DispatchPattern=smaller.SmallerThan)  # -> ListA, ListB
srf_4 = Surface(dispatch_3.ListB)
mesh_3 = Mesh(srf_4)
demesh_2 = DeconstructMesh(Mesh=mesh_3)  # -> Vertices, Faces, Colours, Normals
pdecon = Deconstruct(Point=demesh_2.Vertices)  # -> XComponent, YComponent, ZComponent
vec_5 = VectorXYZ(XComponent=pdecon.XComponent, YComponent=pdecon.YComponent, ZComponent=0)  # -> Vector, Length
z_range_width_2 = Number(z_range_width)
sort = SortList(Keys=vec_5.Length, ValuesA=demesh_2.Vertices)  # -> Keys, ValuesA
vec_6 = VectorXYZ(XComponent=z_range_width_2, YComponent=0, ZComponent=0)  # -> Vector, Length
vec_7 = VectorXYZ(XComponent=0, YComponent=z_range_width_2, ZComponent=0)  # -> Vector, Length
devec = DeconstructVector(Vector=demesh_2.Vertices)  # -> XComponent, YComponent, ZComponent
lng_2 = ListLength(List=sort.ValuesA)
vec_8 = VectorXYZ(XComponent=devec.XComponent, YComponent=devec.YComponent, ZComponent=0)  # -> Vector, Length
subtraction_3 = Subtraction(A=lng_2, B="1")
item = ListItem(List=sort.ValuesA, Index=subtraction_3, Wrap=True)
item_2 = ListItem(List=sort.ValuesA, Index=0, Wrap=True)
addition_2 = Addition(A=item_2, B=vec_7.Vector)
addition_3 = Addition(A=item_2, B=vec_6.Vector)
subtraction_4 = Subtraction(A=vec_8.Vector, B=addition_3)
subtraction_5 = Subtraction(A=vec_8.Vector, B=addition_2)
vlen = VectorLength(Vector=subtraction_4)
vlen_2 = VectorLength(Vector=subtraction_5)
sort_2 = SortList(Keys=vlen, ValuesA=demesh_2.Vertices)  # -> Keys, ValuesA
sort_3 = SortList(Keys=vlen_2, ValuesA=demesh_2.Vertices)  # -> Keys, ValuesA
item_3 = ListItem(List=sort_3.ValuesA, Index=0, Wrap=True)
item_4 = ListItem(List=sort_2.ValuesA, Index=0, Wrap=True)
addition_4 = Addition(A=item_4, B=item_3)
subtraction_6 = Subtraction(A=addition_4, B=item_2)
subtraction_7 = Subtraction(A=item_4, B=item_2)
subtraction_8 = Subtraction(A=item_3, B=item_2)
points = PointList(Points=subtraction_6)
ln_2 = Line(StartPoint=item_3, EndPoint=item_2)
ln_3 = Line(StartPoint=item_4, EndPoint=item_2)
merge = Merge(Data1=item_2, Data2=item_4, Data3=subtraction_6, Data4=item_3)
xprod = CrossProduct(VectorA=subtraction_7, VectorB=subtraction_8, Unitize=False)  # -> Vector, Length
conmesh = ConstructMesh(Vertices=merge, Faces={A=0, B=1, C=2, D=3})
num = Number(flatten(xprod.Length))
ma = MassAddition(Input=num)  # -> Result, PartialResults
panel_5 = Panel(ma.Result)
division_2 = Division(A=ma.Result, B="2")
panel_6 = Panel(division_2)
